# Grasshopper definition 20210209_Facades_02-CURVATURE BASED GRADIENT MANIFOLD RIBS.gh (Grasshopper 1.0.7)
# plug-ins: treesloth01, Weaverbird

# ----
# HARD CODED VARIABLE: RED COLORED COMPONENTS ARE ESSENTIAL TO RUNNING THE SCRIPT, PLEASE DO NOT CHANGE
panel = Panel("X")
geo = Geometry()
# DESCRIPTION PER SECTION: NOTES LOCATED ON THE LEFT BOTTOM CORNER OF EACH PART IS TO EXPLAIN WHAT EACH SECTION OF THE SCRIPT DOES.
# 
# COLORED IN LIGHT BLUE
number_slider = Slider(5, range=0..10)

# ----
# NEEDS IMPROVEMENT: YELLOW COLORED AREAS NEED TO BE IMPROVED: THIS INDICATES THAT THE CURRENT SCRIPT IS FUNCTIONAL BUT COULD BE SHORTER AND QUICKER
# USER INPUT/ADJUSTABLE: GREEN COLORED COMPONENTS ARE OPEN TO USER INPUT AND ADJUSTMENTS
user_choice = BooleanToggle(False)
number_slider_2 = Slider(5, range=0..10)
# Created by:Burcin Nalinci
# Date:09.02.2021
# Project:002_CURVATURE BASED GRADIENT RIBS
# Contact Info: burcinnalinci@gmail.com
# Contributors:Burcin
# Comments: Model units are in inches
# Plugins Needed:Weaverbird
# Color Key
geo_2 = Geometry()

crv = Curve([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])
loft = Loft(Curves=crv, Options={Adjust=False, Closed=False, LoftEnds=0, LoftSimp=0, LoftType=0, Rebuild=10, Refit=0.01})
of_v = Slider(9, range=1..13)
of_u = Slider(51, range=1..101)
srf = Surface(reparameterize(loft))
srf_isocurve = SRFISOCURVE(S=srf, A_2=of_u, A=of_u, A_3=of_v, A_4=of_v)  # -> R_2, i_3, i_4, i, i_2, R
offset_perpendicular_ribs = Slider(0.1, range=0..0.1)
V = Data(simplify(srf_isocurve.i_4))
F = Data(simplify(srf_isocurve.i_2))
U = Data(simplify(srf_isocurve.i_3))
tv = Data(simplify(srf_isocurve.R))
crv_2 = Curve(V)
tu = Data(simplify(srf_isocurve.R_2))
crv_3 = Curve(U)
panel_2 = Panel("""0
-1""")
cull_i = CullIndex(List=tv, Indices=panel_2, Wrap=True)
addition = Addition(A=cull_i, B=offset_perpendicular_ribs)
subtraction = Subtraction(A=cull_i, B=offset_perpendicular_ribs)
item = ListItem(List=tv, Index="-1", Wrap=True)
item_2 = ListItem(List=tv, Index="0", Wrap=True)
merge = Merge(Data1=graft(subtraction), Data2=graft(addition))  # -> flatten(Result)
multiplication = Multiplication(A=offset_perpendicular_ribs, B="2")
subtraction_2 = Subtraction(A=item, B=multiplication)
addition_2 = Addition(A=item_2, B=multiplication)
merge_2 = Merge(
    Data1=simplify(flatten(item_2)),
    Data2=simplify(flatten(addition_2)),
    Data3=simplify(flatten(merge)),
    Data4=simplify(flatten(subtraction_2)),
    Data5=simplify(flatten(item)))

# ---- group: MID POINT FOR EACH RIB INFLECTION PT
shift = ShiftList(List=merge_2, Shift=1, Wrap=False)
partition = PartitionList(List=shift, Size="2")
prune = PruneTree(Tree=partition, Minimum=2, Maximum=0)
avr = Average(Input=prune)
panel_3 = Panel(avr)
flatten = FlattenTree(Tree=panel_3, Path="{0}")

# ----
panel_4 = Panel(merge_2)
merge_3 = Merge(Data1=panel_4, Data2=flatten(panel_3))
crv_4 = Curve(crv_2)
srf_2 = Surface(srf)
sort = SortList(Keys=merge_3, ValuesA=merge_3)  # -> Keys, ValuesA
eval = EvaluateCurve(Curve=reparameterize(crv_4), Parameter=sort.Keys)  # -> Point, Tangent, Angle

# ---- group: Find inflection pts
mindex = MemberIndex(Set=sort.ValuesA, Member=flatten)  # -> flatten(Index), Count
lng = ListLength(List=sort.ValuesA)
panel_5 = Panel(mindex.Index)
repeat = RepeatData(Data="0", Length=lng)
replace = ReplaceItems(List=repeat, Item="1", Indices=panel_5, Wrap=False)

# ----
srf_cp = SurfaceClosestPoint(Point=eval.Point, Surface=srf_2)  # -> Point, UVPoint, Distance
crv_5 = Curve(crv_2)
curvature = Curvature(Curve=reparameterize(crv_5), Parameter=sort.Keys)  # -> P, K, C
evalsrf = EvaluateSurface(Surface=srf_2, Point=srf_cp.UVPoint)  # -> Point, Normal, UDirection, VDirection, Frame
index_inflection_pts = Data(replace)
tstat = TreeStatistics(Tree=evalsrf.Point)  # -> Paths, Length, Count
pt2num = PointsToNumbers(Points=curvature.K, Mask=4)
panel_6 = Panel(pt2num)
pln = Plane(evalsrf.Frame)
count = Data(tstat.Count)
pt = Point(evalsrf.Point)
partition_2 = PartitionList(List=panel_6, Size=3)
bnd = Bounds(Numbers=flatten(curvature.K))
dom = ConstructDomain(DomainStart=Slider(-309.29, range=-1000..1000), DomainEnd=Slider(426.17, range=0..1000))
ma = MassAddition(Input=partition_2)  # -> simplify(Result), PartialResults
smaller = SmallerThan(FirstNumber="0", SecondNumber=ma.Result)  # -> SmallerThan, OrEqualTo
remap = RemapNumbers(Value=curvature.K, Source=bnd, Target=dom)  # -> Mapped, Clipped

# ---- group: ADJUST THIS SO IT MAKES SENSE RELEATIVE TO OTHER DIMENSIONS
number_slider_3 = Slider(20, range=0..1000)

# ----
cset = CreateSet(List=smaller.SmallerThan)  # -> Set, Map
mindex_2 = MemberIndex(Set=cset.Set, Member=smaller.SmallerThan)  # -> Index, Count
weave = Weave(Pattern=mindex_2.Index, Stream0="-1", Stream1="1", NullGaps=False)  # -> simplify(Weave)
pt_2 = Point(pt)
shift_2 = ShiftPaths(Data=weave, Offset=-1)
pln_2 = Plane(pln)
amp = Amplitude(Vector=pln_2, Amplitude=number_slider_3)
multiplication_2 = Multiplication(A=shift_2, B=remap.Mapped)
neg = Negative(Value=amp)
bnd_2 = Bounds(Numbers=multiplication_2)
dom_2 = ConstructDomain(DomainStart=Slider(-65.72, range=-1000..1000), DomainEnd=Slider(108.45, range=0..1000))
remap_2 = RemapNumbers(Value=multiplication_2, Source=bnd_2, Target=dom_2)  # -> Mapped, Clipped
amp_2 = Amplitude(Vector=pln_2, Amplitude=multiplication_2)
inflection_amplitude = Data(remap_2.Mapped)
move = Move(Geometry=pt_2, Motion=neg)  # -> Geometry, Transform
index_inflection_pts_2 = Data(index_inflection_pts)
amp_3 = Amplitude(Vector=pln_2, Amplitude=inflection_amplitude)
tstat_2 = TreeStatistics(Tree=amp_2)  # -> Paths, Length, Count
repeat_2 = RepeatData(Data=graft(index_inflection_pts_2), Length=graft(tstat_2.Count))
flip = FlipMatrix(Data=repeat_2)
multiplication_3 = Multiplication(A=amp_3, B=flip)
multiplication_4 = Multiplication(A=amp_2, B=flip)
move_2 = Move(Geometry=pt_2, Motion=multiplication_4)  # -> Geometry, Transform
move_3 = Move(Geometry=move.Geometry, Motion=multiplication_3)  # -> Geometry, Transform
pt_3 = Point(move_3.Geometry)
pt_4 = Point(move_2.Geometry)
pline = PolyLine(Vertices=pt_3, Closed=False)
pline_2 = PolyLine(Vertices=pt_4, Closed=False)
shift_3 = ShiftList(List=flatten(pline_2), Shift=1, Wrap=False)
partition_3 = PartitionList(List=flatten(pline), Size="2")
partition_4 = PartitionList(List=flatten(shift_3), Size="2")
weave_2 = Weave(Pattern=[0, 1], Stream0=graft(pline), Stream1=graft(pline_2), NullGaps=False)  # -> simplify(Weave)
loft_2 = Loft(Curves=partition_4, Options={Adjust=False, Closed=False, LoftEnds=0, LoftSimp=0, LoftType=0, Rebuild=10, Refit=0.01})
loft_3 = Loft(Curves=partition_3, Options={Adjust=False, Closed=False, LoftEnds=0, LoftSimp=0, LoftType=0, Rebuild=10, Refit=0.01})
debrep = DeconstructBrep(Brep=loft_2)  # -> Faces, Edges, Vertices
loft_4 = Loft(Curves=weave_2, Options={Adjust=False, Closed=False, LoftEnds=0, LoftSimp=0, LoftType=0, Rebuild=10, Refit=0.01})
debrep_2 = DeconstructBrep(Brep=loft_3)  # -> Faces, Edges, Vertices
smesh = SimpleMesh(Brep=debrep.Faces)
smesh_2 = SimpleMesh(Brep=debrep_2.Faces)
attractor_crv = Curve(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)
cull = CullPattern(List=smesh_2, CullPattern=invert([False, True]))
cull_2 = CullPattern(List=smesh, CullPattern=[False, True])
cull_3 = CullPattern(List=smesh, CullPattern=invert([False, True]))
cull_4 = CullPattern(List=smesh_2, CullPattern=[False, True])
merge_4 = Merge(Data1=cull_2, Data2=cull)
merge_5 = Merge(Data1=cull_3, Data2=cull_4)
smesh_3 = SimpleMesh(Brep=loft_4)
area = Area(Geometry=merge_5)  # -> Area, Centroid
crv_cp = CurveClosestPoint(Point=area.Centroid, Curve=attractor_crv)  # -> Point, Parameter, flatten(Distance)
bnd_3 = Bounds(Numbers=crv_cp.Distance)
remap_3 = RemapNumbers(Value=crv_cp.Distance, Source=bnd_3, Target=Domain(0, 1))  # -> Mapped, Clipped
round = Round(Number=remap_3.Mapped)  # -> Nearest, Floor, Ceiling; disabled
cull_5 = CullPattern(List=flatten(merge_5), CullPattern=round.Nearest)  # disabled
cull_6 = CullPattern(List=flatten(merge_5), CullPattern=invert(round.Nearest))  # disabled
mjoin = MeshJoin(Meshes=[merge_4, smesh_3, cull_5])  # -> flatten(Mesh); disabled
number_slider_4 = Slider(2, range=1..6)  # disabled
number_slider_5 = Slider(1, range=1..6)  # disabled
wbjoin = WeaverbirdsJoinMeshesAndWeld(Mesh=mjoin, Weld=False)  # disabled
wbsplitquads = WeaverbirdsConstantQuadsSplitSubdivision(MeshCurves=wbjoin, Level=number_slider_4, SmoothNakedEdges=1)  # disabled
number_slider_6 = Slider(3, range=1..6)  # disabled
number_slider_7 = Slider(5, range=0..100)  # disabled
wbcatmullclark = WeaverbirdsCatmullClarkSubdivision(MeshCurves=wbsplitquads, Level=number_slider_5, SmoothNakedEdges=1)  # disabled
wbjoin_2 = WeaverbirdsJoinMeshesAndWeld(Mesh=cull_6, Weld=False)  # disabled
number_slider_8 = Slider(5, range=0..100)  # disabled
wbthicken = WeaverbirdsMeshThicken(MeshCurves=wbcatmullclark, Distance=number_slider_7, OffsetType=0)  # disabled
wbcatmullclark_2 = WeaverbirdsCatmullClarkSubdivision(MeshCurves=wbjoin_2, Level=number_slider_6, SmoothNakedEdges=1)  # disabled
neg_2 = Negative(Value=number_slider_8)  # disabled
wbthicken_2 = WeaverbirdsMeshThicken(MeshCurves=wbcatmullclark_2, Distance=neg_2, OffsetType=0)  # disabled

# ==== cluster SRFISOCURVE
S = ClusterInput()
A = ClusterInput()
A_2 = ClusterInput()
A_3 = ClusterInput()
A_4 = ClusterInput()
addition = Addition(A=A, B="1")
addition_2 = Addition(A=A_2, B="1")
series = Series(Start=0, Step=addition, Count=addition_2)
addition_3 = Addition(A=A_4, B="1")
addition_4 = Addition(A=A_3, B="1")
series_2 = Series(Start=0, Step=addition_4, Count=addition_3)
bnd = Bounds(Numbers=series)
bnd_2 = Bounds(Numbers=series_2)
remap = RemapNumbers(Value=series_2, Source=bnd_2, Target=Domain(0, 1))  # -> Mapped, Clipped
remap_2 = RemapNumbers(Value=series, Source=bnd, Target=Domain(0, 1))  # -> Mapped, Clipped
panel = Panel(remap.Mapped)
pt = ConstructPoint(XCoordinate=remap_2.Mapped, YCoordinate=graft(remap.Mapped), ZCoordinate=0)
iso = IsoCurve(Surface=reparameterize(S), UVPoint=pt)  # -> UIsocurve, VIsocurve
evalsrf = EvaluateSurface(Surface=reparameterize(S), Point=pt)  # -> Point, Normal, UDirection, VDirection, Frame
R = ClusterOutput(remap.Mapped)
R_2 = ClusterOutput(remap_2.Mapped)
crv = Curve(iso.UIsocurve)
crv_2 = Curve(iso.VIsocurve)
shift = ShiftPaths(Data=evalsrf.Point, Offset=-1)
shift_2 = ShiftPaths(Data=evalsrf.Frame, Offset=-1)
shift_3 = ShiftPaths(Data=crv_2, Offset=-1)
shift_4 = ShiftPaths(Data=crv, Offset=-1)
flip = FlipMatrix(Data=shift)
flip_2 = FlipMatrix(Data=shift_2)
item = ListItem(List=shift_4, Index=0, Wrap=True)
flip_3 = FlipMatrix(Data=shift_3)
item_2 = ListItem(List=flip, Index=0, Wrap=True)
item_3 = ListItem(List=flip_2, Index=0, Wrap=True)
item_4 = ListItem(List=flip_3, Index=0, Wrap=True)
i = ClusterOutput(item_2)
i_2 = ClusterOutput(item_3)
i_3 = ClusterOutput(item)
i_4 = ClusterOutput(item_4)
